# Grasshopper definition shelf-unroll.gh (Grasshopper 1.0.7)

lang = Slider(500, range=0..1000)
shelfheight = Slider(300, range=0..500)
number_slider = Slider(0.1, range=0..0.1)
xz_plane = XZPlane(Origin=Point(0, 0, 0))
length = GetNumber(lang, AtLeast=1, AtMost=1, Maximum=1.797693135e+308, Minimum=-1.797693135e+308)
height = GetNumber(shelfheight, AtLeast=1, AtMost=1, Maximum=1.797693135e+308, Minimum=-1.797693135e+308)
get_number = GetNumber(Slider(110, range=0..300), AtLeast=1, AtMost=1, Maximum=1.797693135e+308, Minimum=-1.797693135e+308)
boolean_toggle = BooleanToggle(False)
unit_y = UnitY(Factor=get_number)
flip_curve = FlipCurve()  # -> Curve, Flag
curve = Curve()
# thickness
number_slider_2 = Slider(2, range=0..10)
material_thickness = GetNumber(number_slider_2, AtLeast=1, AtMost=1, Maximum=1.797693135e+308, Minimum=-1.797693135e+308)
unit_x = UnitX(Factor=material_thickness)
unit_z = UnitZ(Factor=material_thickness)
negative = Negative(Value=unit_z)
negative_2 = Negative(Value=unit_x)

division = Division(A=material_thickness, B=Slider(2, range=0..10))

multiplication = Multiplication(A=height, B=number_slider)
multiplication_2 = Multiplication(A=length, B=number_slider)
plane_surface = PlaneSurface(Plane=xz_plane, XSize=length, YSize=height)
divide_surface = DivideSurface(Surface=plane_surface, UCount=multiplication_2, VCount=multiplication)  # -> Points, Normals, Parameters
deconstruct = Deconstruct(Point=divide_surface.Points)  # -> XComponent, YComponent, ZComponent
# shelf style - for sine
adjust_style = GetNumber(Slider(58.2, range=0..100), AtLeast=1, AtMost=1, Maximum=1.797693135e+308, Minimum=-1.797693135e+308)
division_2 = Division(A=deconstruct.XComponent, B=adjust_style)
division_3 = Division(A=deconstruct.ZComponent, B=adjust_style)
material_thickness_2 = Slider(40, range=0..100)
sine = Sine(Value=division_2)
cosine = Cosine(Value=division_3)
multiplication_3 = Multiplication(A=sine, B=cosine)
multiplication_4 = Multiplication(A=multiplication_3, B=Slider(25, range=10..25))

depth = GetNumber(material_thickness_2, AtLeast=1, AtMost=1, Maximum=1.797693135e+308, Minimum=-1.797693135e+308)

addition = Addition(A=multiplication_4, B=depth)
negative_3 = Negative(Value=addition)
construct_point = ConstructPoint(XCoordinate=deconstruct.XComponent, YCoordinate=negative_3, ZCoordinate=deconstruct.ZComponent)
construct_point_2 = ConstructPoint(XCoordinate=deconstruct.XComponent, YCoordinate=negative_3, ZCoordinate=deconstruct.ZComponent)
surface_from_points = SurfaceFromPoints(Points=flatten(construct_point), UCount=expr("x+1", multiplication_2), Interpolate=False)
project = Project(Geometry=surface_from_points, Plane=xz_plane)  # -> Geometry, Transform
curve_2 = Curve(surface_from_points)
weave = Weave(Pattern=[0, 1], Stream0=curve_2, Stream1=project.Geometry, NullGaps=False)
loft = Loft(Curves=weave, Options={Adjust=False, Closed=False, LoftEnds=0, LoftSimp=2, LoftType=0, Rebuild=10, Refit=0.01})
merge = Merge(Data1=plane_surface, Data2=loft, Data3=surface_from_points)

deconstruct_brep = DeconstructBrep(Brep=project.Geometry)  # -> Faces, Edges, Vertices
list_item = ListItem(List=deconstruct_brep.Vertices, Index=0, Wrap=True)  # -> Item, Item1, Item2, Item3, Item4
move = Move(Geometry=list_item.Item1, Motion=unit_y)  # -> Geometry, Transform
move_2 = Move(Geometry=list_item.Item, Motion=unit_y)  # -> Geometry, Transform
deconstruct_brep_2 = DeconstructBrep(Brep=surface_from_points)  # -> Faces, Edges, Vertices
_4point_surface = _4PointSurface(CornerA=list_item.Item3, CornerB=move_2.Geometry, CornerC=move.Geometry, CornerD=list_item.Item2)
list_item_2 = ListItem(List=deconstruct_brep_2.Vertices, Index=Slider(0, range=0..10), Wrap=True)
flip = Flip(Surface=_4point_surface)  # -> Surface, Result
weave_2 = Weave(Pattern=[0, 1], Stream0=curve_2, Stream1=flip.Surface, NullGaps=False)
loft_2 = Loft(Curves=weave_2, Options={Adjust=False, Closed=False, LoftEnds=0, LoftSimp=2, LoftType=0, Rebuild=10, Refit=0.01})

brep_join = BrepJoin(Breps=merge)  # -> Breps, Closed
unit_x_2 = UnitX(Factor=1)
unit_z_2 = UnitZ(Factor=1)

# ----
# subdivision
subdivision = GetNumber(Slider(25, range=0..100), AtLeast=1, AtMost=1, Maximum=1.797693135e+308, Minimum=-1.797693135e+308)

contour = Contour(Shape=brep_join.Breps, Point=Point(0, 0, 0), Direction=unit_z_2, Distance=subdivision)  # -> flatten(Contours)
contour_2 = Contour(Shape=brep_join.Breps, Point=Point(0, 0, 0), Direction=unit_x_2, Distance=subdivision)  # -> flatten(Contours)

number_slider_3 = Slider(0, range=0..100)
cull_index = CullIndex(List=contour, Indices=number_slider_3, Wrap=True)
# cull outter ribs
# if required
cull_index_2 = CullIndex(List=cull_index, Indices=number_slider_3, Wrap=True)

number_slider_4 = Slider(0, range=0..100)
cull_index_3 = CullIndex(List=contour_2, Indices=number_slider_4, Wrap=True)  # -> reverse(List)
cull_index_4 = CullIndex(List=cull_index_3, Indices=number_slider_4, Wrap=True)

move_3 = Move(Geometry=cull_index_4, Motion=unit_x)  # -> Geometry, Transform
move_4 = Move(Geometry=contour, Motion=unit_z)  # -> Geometry, Transform
surface = Surface(move_3.Geometry)
surface_2 = Surface(move_4.Geometry)

# ----
# cost estimation
area = Area(Geometry=[surface, surface_2])  # -> Area, Centroid
curve_3 = Curve(surface_2)
curve_4 = Curve(surface)
length_2 = Length(Curve=curve_4)
mass_addition = MassAddition(Input=length_2)  # -> Result, PartialResults
mass_addition_2 = MassAddition(Input=area.Area)  # -> Result, PartialResults
division_4 = Division(A=mass_addition.Result, B="2400")
multiplication_5 = Multiplication(A=division_4, B="100")
multiplication_6 = Multiplication(A=mass_addition_2.Result, B="0.0001")
multiplication_7 = Multiplication(A=multiplication_6, B="36")
addition_2 = Addition(A=multiplication_5, B=multiplication_7)
multiplication_8 = Multiplication(A=addition_2, B="2")
format = Format(Format="{0:0.00}", Culture=127, Data0=multiplication_8)
c_script = CSharpScript(crv=[curve_4, curve_3], cost=format)  # -> out, A; inputs crv: Curve, cost: String
# ---------- c_script: C# ----------
    crv.SetUserString("cost", cost);
    A = crv;
# ---------- end c_script ----------

# ---- group: RH_OUT:preferences
curve_5 = Curve(flatten(c_script.A))

# ----
compute_blueprint = GetBoolean(Toggle(False), AtLeast=1, AtMost=1, FalseValue="False", TrueValue="True")

stream_gate = StreamGate(Stream=surface, Gate=compute_blueprint)  # -> Target0, Target1

stream_gate_2 = StreamGate(Stream=surface_2, Gate=compute_blueprint)  # -> Target0, Target1, Target2, Target3

extrude = Extrude(Base=stream_gate.Target0, Direction=negative_2)
extrude_2 = Extrude(Base=stream_gate_2.Target0, Direction=negative)

# ---- group: RH_OUT:view
mesh = Mesh([extrude_2, extrude])

# ----
cross_reference = CrossReference(ListListA=stream_gate.Target1, ListListB=stream_gate_2.Target1, CrossMode=1)  # -> ListListA, ListListB
brep_brep = BrepBrep(BrepA=cross_reference.ListListA, BrepB=cross_reference.ListListB)  # -> Curves, Points
division_5 = Division(A=material_thickness, B=Slider(2, range=0..10))
number_slider_5 = Slider(0.5, range=0..1)
construct_domain = ConstructDomain(DomainStart=number_slider_5, DomainEnd=1)
sub_curve = SubCurve(BaseCurve=reparameterize(brep_brep.Curves), Domain=construct_domain)
sub_curve_2 = SubCurve(BaseCurve=reparameterize(brep_brep.Curves), Domain=number_slider_5)
# intersection
panel = Panel("0")
extend_curve = ExtendCurve(Curve=sub_curve, Type=0, Start="0", End=sub_curve)
extend_curve_2 = ExtendCurve(Curve=sub_curve_2, Type=0, Start=sub_curve_2, End=panel)
pipe = Pipe(Curve=extend_curve, Radius=division_5, Caps=1)  # -> flatten(Pipe)
pipe_2 = Pipe(Curve=extend_curve_2, Radius=division_5, Caps=1)  # -> flatten(Pipe)
trim_solid = TrimSolid(Shape=stream_gate_2.Target1, Cutters=pipe)
trim_solid_2 = TrimSolid(Shape=stream_gate.Target1, Cutters=pipe_2)
unit_x_3 = UnitX(Factor=division)
unit_z_3 = UnitZ(Factor=division)
negative_4 = Negative(Value=unit_x_3)
negative_5 = Negative(Value=unit_z_3)
extrude_3 = Extrude(Base=trim_solid_2, Direction=[unit_x_3, negative_4])
extrude_4 = Extrude(Base=trim_solid, Direction=[negative_5, unit_z_3])

# ----
# vertical
solid_union = SolidUnion(Breps=extrude_3)

# ----
# horizontal
solid_union_2 = SolidUnion(Breps=extrude_4)

list_length = ListLength(List=solid_union_2)
unit_y_2 = UnitY(Factor=Slider(155, range=0..1000))
xy_plane = XYPlane(Origin=Point(0, 0, 0))
number_slider_6 = Slider(26, range=0..100)
move_5 = Move(Geometry=xy_plane, Motion=unit_y_2)  # -> Geometry, Transform
number = Number(flatten(list_length))
area_2 = Area(Geometry=surface_2)  # -> Area, flatten(Centroid)
rectangular = Rectangular(Plane=move_5.Geometry, SizeX=lang, SizeY=lang, ExtentX=Slider(3, range=0..10), ExtentY=Slider(3, range=0..20))  # -> Cells, Points
point_list = PointList(Points=area_2.Centroid, Size=number_slider_6)
shortest_list = ShortestList(ListListA=flatten(rectangular.Points), ListListB=area_2.Centroid, TrimMode=2)  # -> ListListA, ListListB
flatten_tree = FlattenTree(Tree=rectangular.Points, Path="{0}")
vector_2pt = Vector2Pt(PointA=area_2.Centroid, PointB=flatten(shortest_list.ListListA), Unitize=False)  # -> Vector, Length
point_list_2 = PointList(Points=rectangular.Points, Size=number_slider_6)
move_6 = Move(Geometry=flatten(solid_union_2), Motion=vector_2pt.Vector)  # -> Geometry, Transform

# ---- group: RH_OUT:mesh
# unroll
mesh_2 = Mesh([solid_union, solid_union_2])

# ----
custom_preview = CustomPreview(
    Geometry=mesh_2,
    Material={diffuse=RGB(221, 160, 221), emission=RGB(66, 48, 66), shine=0.5, specular=RGB(255, 255, 255), transparency=0})
